# Grasshopper definition 03_bridge_2d.ghx (Grasshopper 1.0.7)
# plug-ins: Human

crv = Curve(Tree({0;0}: [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], {0;1}: [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]))
pt = Point([Point(6.5, 0, 0), Point(-6.5, 0, 0)])
crv_2 = Curve(Tree({0;0}: [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], {0;1}: [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], {0;2}: [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]))
pt_2 = Point([Point(15.70208686, 0, 28.84098853), Point(-20.67104257, 0, 42.70239629)])
pt_3 = Point([Point(-6.5, 0, 48), Point(6.5, 0, 48)])

# ---- group: Context
crv_3 = Curve([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])
preview = CustomPreview(Geometry=crv_3, Material=ColourSwatch(SwatchColor=RGB(196, 196, 196)))

# ---- group: Build topology diagram
deviation_edge_force = Panel("5")
load_magnitude = Slider(-10, range=-10..0)
crv_4 = Curve(crv)
crv_5 = Curve(crv_2)
pt_4 = Point(pt_3)
pt_5 = Point(pt)
end = EndPoints(Curve=crv_4)  # -> Start, End
neg = Negative(Value=deviation_edge_force)
entwine = Entwine(Branch00=deviation_edge_force, Branch01=deviation_edge_force, Branch02=neg, FlattenInputs=True)
len = Length(Curve=crv_4)
Z = UnitZ(Factor=load_magnitude)
ln = Line(StartPoint=end.Start, EndPoint=end.End)
nodeload = NodeLoad(point=pt_5, vector=Z)  # -> flatten(node_load); inputs point: Point3d, vector: Vector3d
#   port point: The position of the node where to apply the load.
#   port vector: The load vector.
#   port node_load: A COMPAS CEM node load.
# ---------- nodeload: Python ----------
"""
Create a load vector to be applied at a node.
"""
from ghpythonlib.componentbase import executingcomponent as component

from compas_cem.loads import NodeLoad


class NodeLoadComponent(component):
    def RunScript(self, point, vector):
        if point and vector:
            return NodeLoad.from_rhino_point_and_vector(point, vector)
# ---------- end nodeload ----------
nodesupport = NodeSupport(point=pt_4)  # -> flatten(node_support); inputs point: Point3d
#   port point: The position of the node where to assign a support.
#   port node_support: A COMPAS CEM node support.
# ---------- nodesupport: Python ----------
"""
Create a node support from a rhino point.
"""
from ghpythonlib.componentbase import executingcomponent as component

from compas_cem.supports import NodeSupport


class NodeSupportComponent(component):
    def RunScript(self, point):
        if point:
            return NodeSupport.from_rhino_point(point)
# ---------- end nodesupport ----------

# ----
deviation_edge = DeviationEdge(line=crv_5, force=entwine)  # -> deviation_edge; inputs line: Line
#   port line: A line that defines the end nodes of the edge.
#   port force: The desired force on the edge. If negative, the edge is in compression. Otherwise, it is in tension.
#   port deviation_edge: A COMPAS CEM deviation edge.
# ---------- deviation_edge: Python ----------
"""
Create a deviation edge from a rhino line.
"""
from ghpythonlib.componentbase import executingcomponent as component

from compas_cem.elements import DeviationEdge


class DeviationEdgeComponent(component):
    def RunScript(self, line, force):
        if line and force is not None:
            return DeviationEdge.from_rhino_line(line, force=force)
# ---------- end deviation_edge ----------
trail_edge = TrailEdge(line=ln, length=len)  # -> trail_edge; inputs line: Line, plane: Plane
#   port line: A line that defines the end nodes of the edge.
#   port length: The signed length of the edge. If negative, the edge is in compression. Otherwise, it is in tension. The length magnitude is ignored if a plane is supplied.
#   port plane: An optional plane to implicitly define the length of the trail edge. The force state will be that specified by the length input parameter.
#   port trail_edge: A COMPAS CEM trail edge.
# ---------- trail_edge: Python ----------
"""
Create a trail edge from a rhino line.
"""
from ghpythonlib.componentbase import executingcomponent as component

from compas.geometry import Plane
from compas.geometry import cross_vectors

from compas_rhino.geometry import RhinoPlane

from compas_cem.elements import TrailEdge


class TrailEdgeComponent(component):
    def RunScript(self, line, length, plane):
        if plane is not None:
            plane = RhinoPlane.from_geometry(plane).to_compas()
            plane = Plane(plane.point, cross_vectors(plane.xaxis, plane.yaxis))
        if line and length is not None:
            return TrailEdge.from_rhino_line(line, length=length, plane=plane)
# ---------- end trail_edge ----------

# ---- group: Build topology diagram (continued)
topologydiagram = TopologyDiagram(trail_edges=flatten(trail_edge), deviation_edges=flatten(deviation_edge), loads=nodeload, supports=nodesupport)  # -> topology; inputs nodes: list, trail_edges: list, deviation_edges: list, loads: list, supports: list
#   port nodes: A list of COMPAS CEM nodes to add to the diagram.
#   port trail_edges: A list of COMPAS CEM trail edges to add to the diagram.
#   port deviation_edges: A list of COMPAS CEM deviation edges to add to the diagram.
#   port loads: A list of COMPAS CEM loads to add to the diagram.
#   port supports: A list of COMPAS CEM supports to add to the diagram.
#   port topology: A COMPAS CEM topology diagram.
# ---------- topologydiagram: Python ----------
"""
Build a topology diagram.
"""
from ghpythonlib.componentbase import executingcomponent as component

from compas_cem.diagrams import TopologyDiagram


class BuildTopologyDiagramComponent(component):
    def RunScript(self, nodes, trail_edges, deviation_edges, loads, supports):

        topology = TopologyDiagram()

        if nodes:
            for node in nodes:
                topology.add_node(node)

        if trail_edges:
            for trail_edge in trail_edges:
                topology.add_edge(trail_edge)

        if deviation_edges:
            for deviation_edge in deviation_edges:
                topology.add_edge(deviation_edge)

        if loads:
            for load in loads:
                topology.add_load(load)

        if supports:
            for support in supports:
                topology.add_support(support)

        return topology
# ---------- end topologydiagram ----------
buildtrails = BuildTrails(topology=topologydiagram)  # -> topology, trails, auxiliary_trails; inputs add_auxiliary_trails: Boolean, auxiliary_trail_vector: Vector3d
#   port topology: A COMPAS CEM topology diagram.
#   port add_auxiliary_trails: Append auxiliary trail edges to the free nodes of the topology diagram. Defaults to False.
#   port auxiliary_trail_length: The length of the auxiliary trail edges to add. Defaults to 1.0.
#   port auxiliary_trail_vector: The direction to which the auxiliary trail edges will initially point to. Defaults to [1.0, 1.0, 1.0].
#   port topology: The input topology diagram. But now with computed trails.
#   port trails: The keys of the nodes in each of the found trails.
#   port auxiliary_trails: The keys of the appended auxiliary trail edges.
# ---------- buildtrails: Python ----------
"""
Automatically find the trails in a topology diagram. The diagram is modified in-place.
"""
from ghpythonlib.componentbase import executingcomponent as component

from compas_rhino.geometry import RhinoVector


class BuildTopologyDiagramComponent(component):
    def RunScript(self, topology, add_auxiliary_trails, auxiliary_trail_length, auxiliary_trail_vector):
        add_auxiliary_trails = add_auxiliary_trails or False

        if topology:

            topology = topology.copy()

            if auxiliary_trail_length:
                topology.auxiliary_trail_length = auxiliary_trail_length
            if auxiliary_trail_vector:
                topology.auxiliary_trail_vector = RhinoVector.from_geometry(auxiliary_trail_vector).to_compas()

            topology.build_trails(add_auxiliary_trails)

            trails = list(topology.trails())
            auxiliary_trails = list(topology.auxiliary_trail_edges())

            return topology, trails, auxiliary_trails
# ---------- end buildtrails ----------
data = Data(buildtrails.topology)

# ---- group: Constrained Form-finding
pt_6 = Point(pt_3)
data_2 = Data(data)
pt_7 = Point(pt_2)
bounds = Panel("20")
cp = ClosestPoint(Point=pt_7, Cloud=pt_6)  # -> ClosestPoint, CPIndex, Distance
topologydisassembly = DisassembleTopologyDiagram(topology=data_2)  # -> nodes, origin_nodes, support_nodes, edges, trail_edges, deviation_edges, trails, auxiliary_trails
#   port topology: A COMPAS CEM topology diagram.
#   port nodes: All the node keys in the topology diagram.
#   port origin_nodes: The keys of the origin nodes in the topology diagram.
#   port support_nodes: The keys of the support nodes in the topology diagram.
#   port edges: All the edge keys in the topology diagram.
#   port trail_edges: The keys of the trail edges in the topology diagram.
#   port deviation_edges: The keys of the deviation edges in the topology diagram.
#   port trails: The trails in the topology diagram.
#   port auxiliary_trails: The auxiliary trails in the topology diagram.
# ---------- topologydisassembly: Python ----------
"""
Disassemble a topology diagram into its constituent parts.
"""
from ghpythonlib.componentbase import executingcomponent as component


class TopologyDisassemblyComponent(component):
    def RunScript(self, topology):
        if topology:
            trails = list(topology.trails())
            auxiliary_trails = list(topology.auxiliary_trails())

            edges = list(topology.edges())
            trail_edges = list(topology.trail_edges())
            deviation_edges = list(topology.deviation_edges())

            nodes = list(topology.nodes())
            origin_nodes = list(topology.origin_nodes())
            support_nodes = list(topology.support_nodes())

            return nodes, origin_nodes, support_nodes, edges, trail_edges, deviation_edges, trails, auxiliary_trails
# ---------- end topologydisassembly ----------
nodesearch = NodeSearch(diagram=data_2, point=pt_6)  # -> node; inputs point: list of Point3d
#   port diagram: A COMPAS CEM topology or form diagram.
#   port point: The points to search for in the diagram.
#   port node: The node keys.
# ---------- nodesearch: Python ----------
"""
Search a node key in a topology or a form diagram using a point.
"""
from ghpythonlib.componentbase import executingcomponent as component

from compas.utilities import geometric_key
from compas_rhino.geometry import RhinoPoint


class NodeSearchComponent(component):
    def RunScript(self, diagram, point):
        if point and diagram:
            node = []
            for pt in point:
                pt = RhinoPoint.from_geometry(pt).to_compas()
                gkey = geometric_key(pt, diagram.tol)
                node.append(diagram.gkey_node[gkey])
            return node
# ---------- end nodesearch ----------
item = ListItem(List=pt_7, Index=cp.CPIndex, Wrap=True)
pointconstraint = PointConstraint(node_key=nodesearch, point=item)  # -> constraint; inputs node_key: Int32, point: Point3d
#   port node_key: The key of a COMPAS CEM node.
#   port point: The target point.
#   port weight: The weight of the constraint in the optimization problem. Defaults to one.
#   port constraint: A COMPAS CEM node point constraint.
# ---------- pointconstraint: Python ----------
"""
Pull the position of a node to a target point.
"""
from ghpythonlib.componentbase import executingcomponent as component

from compas_cem.optimization import PointConstraint
from compas_rhino.geometry import RhinoPoint


class PointConstraintComponent(component):
    def RunScript(self, node_key, point, weight):
        weight = weight or 1.0
        if node_key is not None and point:
            point = RhinoPoint.from_geometry(point).to_compas()
            return PointConstraint(node_key, point, weight)
# ---------- end pointconstraint ----------
trailedgelengthparameter = TrailEdgeLengthParameter(edge_key=topologydisassembly.trail_edges, bound_low=bounds, bound_up=bounds)  # -> parameter
#   port edge_key: The key of a COMPAS CEM trail edge.
#   port bound_low: The lower bound of the edge optimization parameter. Calculated as the initial edge parameter minus the absolute value of this bound.
#   port bound_up: The upper bound of the edge optimization parameter. Calculated as the initial edge parameter plus the absolute value of this bound.
#   port parameter: A COMPAS CEM trail edge length parameter.
# ---------- trailedgelengthparameter: Python ----------
"""
Set the length of a trail edge as an optimization parameter.
"""
from ghpythonlib.componentbase import executingcomponent as component

from compas_cem.optimization import TrailEdgeParameter


class TrailEdgeParameterComponent(component):
    def RunScript(self, edge_key, bound_low, bound_up):
        if edge_key and bound_low is not None and bound_up is not None:
            return TrailEdgeParameter(edge_key, bound_low, bound_up)
# ---------- end trailedgelengthparameter ----------
deviationedgeforceparameter = DeviationEdgeForceParameter(edge_key=topologydisassembly.deviation_edges, bound_low=bounds, bound_up=bounds)  # -> parameter
#   port edge_key: The key of a COMPAS CEM deviation edge.
#   port bound_low: The lower bound of the edge optimization parameter. Calculated as the initial edge parameter minus the absolute value of this bound.
#   port bound_up: The upper bound of the edge optimization parameter. Calculated as the initial edge parameter plus the absolute value of this bound.
#   port parameter: A COMPAS CEM deviation edge force parameter.
# ---------- deviationedgeforceparameter: Python ----------
"""
Set the force of a deviation edge as an optimization parameter.
"""
from ghpythonlib.componentbase import executingcomponent as component

from compas_cem.optimization import DeviationEdgeParameter


class DeviationEdgeParameterComponent(component):
    def RunScript(self, edge_key, bound_low, bound_up):
        if edge_key and bound_low is not None and bound_up is not None:
            return DeviationEdgeParameter(edge_key, bound_low, bound_up)
# ---------- end deviationedgeforceparameter ----------
constrained_form_finding = ConstrainedFormFinding(topology=data_2, constraints=pointconstraint, parameters=[trailedgelengthparameter, deviationedgeforceparameter])  # -> form, objective, grad_norm, iters, time, status; inputs constraints: list, parameters: list, iters_max: Int32, tmax: Int32
#   port topology: A COMPAS CEM topology diagram.
#   port constraints: A list of COMPAS CEM optimization constraints.
#   port parameters: A list of COMPAS CEM optimization parameters.
#   port algorithm: The name of the optimization algorithm to use.
#   port iters_max: The maximum number of iterations to run the optimization algorithm for. Defaults to 100.
#   port eps: The minimum objective or norm of the gradient value to declare convergence. Defaults to 1e-6.
#   port tmax: The maximum number of iterations to run the form-finding algorithm for. Defaults to 100.
#   port eta: The convergence threshold of the form-finding algorithm. Default to 1e-6.
#   port form: A COMPAS CEM form diagram in static equilibrium.
#   port objective: The resulting value of the objective function.
#   port grad_norm: The norm of the gradient of the objective function.
#   port iters: The elapsed number of iterations.
#   port time: The optimization elapsed time.
#   port status: The final status of the optimization process.
# ---------- constrained_form_finding: Python ----------
"""
Generate a form diagram in static equilibrium.
"""
from ghpythonlib.componentbase import executingcomponent as component

from compas_cem import PROXY_PORT

from compas.rpc import Proxy


class ConstrainedFormFindingComponent(component):
    def RunScript(self, topology, constraints, parameters, algorithm, iters_max, eps, tmax, eta):
        algorithm = algorithm or "LD_SLSQP"
        iters_max = iters_max or 100
        eps = eps or 1e-6
        tmax = tmax or 100
        eta = eta or 1e-6

        if topology and constraints and parameters:
            topology = topology.copy()

            with Proxy("compas_cem.optimization", port=PROXY_PORT) as opt:
                solution = opt.solve_nlopt_proxy(topology,
                                                 constraints,
                                                 parameters,
                                                 algorithm,
                                                 iters_max,
                                                 eps,
                                                 tmax,
                                                 eta)

            form, objective, grad_norm, iters, time, status = solution
            return form, objective, grad_norm, iters, time, status
# ---------- end constrained_form_finding ----------
data_3 = Data(constrained_form_finding.form)
panel = Panel(constrained_form_finding.grad_norm)
panel_2 = Panel(constrained_form_finding.iters)
panel_3 = Panel(constrained_form_finding.objective)
panel_4 = Panel(constrained_form_finding.status)
panel_5 = Panel(constrained_form_finding.time)

# ---- group: Form-finding
data_4 = Data(data)
formfinding = FormFinding(topology=data_4)  # -> form; inputs tmax: Int32
#   port topology: A COMPAS CEM topology diagram.
#   port tmax: The maximum number of iterations to run the form-finding algorithm for. Defaults to 100.
#   port eps_min: The convergence threshold of the form-finding algorithm. Default to 1e-6.
#   port form: A COMPAS CEM form diagram in static equilibrium.
# ---------- formfinding: Python ----------
"""
Generate a form diagram in static equilibrium.
"""
from ghpythonlib.componentbase import executingcomponent as component

from compas_cem.equilibrium import static_equilibrium


class FormFindingComponent(component):
    def RunScript(self, topology, tmax, eta_min):
        tmax = tmax or 100
        eta_min = eta_min or 1e-6
        if topology:
            return static_equilibrium(topology, tmax=tmax, eta=eta_min)
# ---------- end formfinding ----------
data_5 = Data(formfinding)

# ----
view_constrained_form = BooleanToggle(True)
data_6 = Data(data_3)
data_7 = Data(data_5)
filter = StreamFilter(Gate=view_constrained_form, Stream0=data_7, Stream1=data_6)
data_8 = Data(filter)

# ---- group: Draw form diagram
thickness_scale = Panel("0.4")
data_9 = Data(data_8)
list = ValueList({"Forces": 0, "Lengths": 1}, selected="Forces")
edgeresults = EdgeResults(form=data_9)  # -> length, force; inputs edge: list
#   port form: A COMPAS CEM form diagram.
#   port edge: A selection of edge keys to query the results on. Defaults to all the edges.
#   port length: The edge lengths.
#   port force: The edge forces.
# ---------- edgeresults: Python ----------
"""
Extract the post form-finding results of the edges in a form diagram.
"""
from ghpythonlib.componentbase import executingcomponent as component


class EdgeResultsComponent(component):
    def RunScript(self, form, edge):
        if form:
            edge = edge or list(form.edges())
            length = [form.edge_length_2(ed) for ed in edge]
            force = [form.edge_force(ed) for ed in edge]
            return length, force
# ---------- end edgeresults ----------
cem_colors = CEMColors()  # -> color_tension, color_compression, color_edge, color_node, color_node_support, color_node_origin, color_load, color_reaction, color_trail, color_auxiliary_trail
#   port color_tension: The color for edges under a tension force.
#   port color_compression: The color for edges under a compression force.
#   port color_edge: The color for a regular edge.
#   port color_node: The color for a regular node.
#   port color_node_support: The color for a support node.
#   port color_node_origin: The color for an origin node.
#   port color_load: The color for an applied load.
#   port color_reaction: The color for a reaction force.
#   port color_trail: The color to paint a trail.
#   port color_auxiliary_trail: The color to paint an auxiliary trail.
# ---------- cem_colors: Python ----------
"""
Get the artists color scheme for the objects of the CEM framework.
"""
from ghpythonlib.componentbase import executingcomponent as component

from compas_cem import COLORS
import rhinoscriptsyntax as rs


class ArtistColorsComponent(component):
    def RunScript(self):
        colors = {key: rs.CreateColor(c) for key, c in COLORS.items()}

        color_tension = colors["tension"]
        color_compression = colors["compression"]
        color_edge = colors["edge"]
        color_node = colors["node"]
        color_node_support = colors["node_support"]
        color_node_origin = colors["node_origin"]
        color_load = colors["load"]
        color_reaction = colors["support_force"]
        color_trail = colors["trail"]
        color_auxiliary_trail = colors["auxiliary_trail"]

        colors = (color_tension, color_compression, color_edge, color_node, color_node_support, color_node_origin, color_load, color_reaction, color_trail, color_auxiliary_trail)

        return colors
# ---------- end cem_colors ----------
formartist = FormArtist(form=data_9)  # -> nodes, support_nodes, edges, loads, reactions; inputs node: list of Int32, edge: list
#   port form: A COMPAS CEM topology diagram.
#   port node: A selection of the nodes in the diagram. Defaults to all the nodes.
#   port edge: A selection of the edges in the diagram. Defaults to all the edges.
#   port force_min: The smallest force magnitude to draw. Defaults to 1e-3
#   port force_scale: The scale of the loads and the reactions. Defaults to 1.
#   port nodes: The nodes of the diagram as points.
#   port support_nodes: The support nodes of the diagram as points
#   port edges: The edges of the diagram as lines.
#   port loads: The applied loads as lines.
#   port reactions: The reaction forces at the supports, as lines.
# ---------- formartist: Python ----------
"""
Draw a form diagram.
"""
from ghpythonlib.componentbase import executingcomponent as component

from compas_cem.ghpython import FormArtist


class FormArtistComponent(component):
    def RunScript(self, form, node, edge, force_min, force_scale):
        force_min = force_min or 1e-3
        force_scale = force_scale or 1
        if form:
            artist = FormArtist(form)

            nodes = artist.draw_nodes(node)
            edges = artist.draw_edges(edge)
            support_nodes = artist.draw_nodes_support(node)

            loads = artist.draw_loads(node, min_load=force_min, scale=force_scale)
            reactions = artist.draw_reactions(node, min_force=force_min, scale=force_scale)

            return nodes, support_nodes, edges, loads, reactions
# ---------- end formartist ----------
abs = Absolute(Value=edgeresults.force)
filter_2 = StreamFilter(Gate=list, Stream0=edgeresults.force, Stream1=edgeresults.force)
larger = LargerThan(FirstNumber=edgeresults.force, SecondNumber=0)  # -> LargerThan, OrEqualTo
multiplication = Multiplication(A=abs, B=thickness_scale)
merge = Merge(Data1=cem_colors.color_compression, Data2=cem_colors.color_tension)
python = GhPythonScript(x=filter_2)  # -> out, a
# ---------- python: Python ----------
a = round(x, 3)
# ---------- end python ----------
end_2 = EndPoints(Curve=formartist.loads)  # -> Start, End
midpt = CurveMiddle(Curve=formartist.edges)
item_2 = ListItem(List=merge, Index=larger.OrEqualTo, Wrap=True)
end_3 = EndPoints(Curve=formartist.reactions)  # -> Start, End
swatch = ColourSwatch(SwatchColor=RGBA(156, 156, 156, 195))
vec2pt = Vector2Pt(PointA=end_2.Start, PointB=end_2.End, Unitize=False)  # -> Vector, Length
vec2pt_2 = Vector2Pt(PointA=end_3.Start, PointB=end_3.End, Unitize=False)  # -> Vector, Length

# ---- group: Draw topology diagram
dash_length = Panel("0.05")
sphere_scale = Panel("0.5")
data_10 = Data(data)
topologyartist = TopologyArtist(topology=data_10)  # -> nodes, origin_nodes, support_nodes, edges, trail_edges, deviation_edges, loads; inputs node: list of Int32, edge: list
#   port topology: A COMPAS CEM topology diagram.
#   port node: A selection of the nodes in the diagram. Defaults to all the nodes.
#   port edge: A selection of the edges in the diagram. Defaults to all the edges.
#   port load_min: The minimum load magnitude to plot. Defaults to 1e-3.
#   port load_scale: The scaling factor of the loads. Defaults to 1.
#   port nodes: The nodes in the diagram as points.
#   port origin_nodes: The origin nodes in the diagram as points.
#   port support_nodes: The position of the support nodes in the diagram.
#   port edges: The edges in the diagram as lines.
#   port trail_edges: The trail edges in the diagram as lines.
#   port deviation_edges: The deviation edges in the diagram as lines.
#   port loads: The applied node loads as lines.
# ---------- topologyartist: Python ----------
"""
Draw a topology diagram.
"""
from ghpythonlib.componentbase import executingcomponent as component

from compas_cem.ghpython import TopologyArtist


class TopologyArtistComponent(component):
    def RunScript(self, topology, node, edge, load_min, load_scale):
        node = node or None
        edge = edge or None
        load_min = load_min or 1e-3
        load_scale = load_scale or 1.0
        if topology:
            artist = TopologyArtist(topology)

            nodes = artist.draw_nodes(node)
            origin_nodes = artist.draw_nodes_origin(node)
            support_nodes = artist.draw_nodes_support(node)

            edges = artist.draw_edges(edge)
            trail_edges = artist.draw_edges_trail(node)
            deviation_edges = artist.draw_edges_deviation(node)

            loads = artist.draw_loads(node, min_load=load_min, scale=load_scale)

            return nodes, origin_nodes, support_nodes, edges, trail_edges, deviation_edges, loads
# ---------- end topologyartist ----------
cem_colors_2 = CEMColors()  # -> color_tension, color_compression, color_edge, color_node, color_node_support, color_node_origin, color_load, color_reaction, color_trail, color_auxiliary_trail; same code as cem_colors
dash = DashPattern(Curve=topologyartist.deviation_edges, Pattern=dash_length)  # -> Dashes, Gaps
entwine_2 = Entwine(Branch00=cem_colors_2.color_node_origin, Branch01=cem_colors_2.color_node_support, FlattenInputs=True)
entwine_3 = Entwine(Branch00=topologyartist.trail_edges, Branch01=dash.Dashes, FlattenInputs=True)
entwine_4 = Entwine(Branch00=topologyartist.origin_nodes, Branch01=topologyartist.support_nodes, FlattenInputs=True)
entwine_5 = Entwine(
    Branch00=ColourSwatch(SwatchColor=RGB(209, 2, 255)),
    Branch01=ColourSwatch(SwatchColor=RGB(255, 156, 0)),
    FlattenInputs=True)
sph = Sphere(Base=entwine_4, Radius=sphere_scale)

# ----
preview_2 = CustomPreview(Geometry=entwine_3, Material=entwine_5)
preview_3 = CustomPreview(Geometry=sph, Material=entwine_2)

vdisex = VectorDisplayEx(Point=end_3.Start, Vector=vec2pt_2.Vector, Colour=cem_colors.color_load, Width=2)
vdisex_2 = VectorDisplayEx(Point=end_2.Start, Vector=vec2pt.Vector, Colour=cem_colors.color_load, Width=2)
previewlw = CustomPreviewLineweights(Geometry=formartist.edges, Shader=item_2, Thickness=multiplication, Absolute=False)

tag = TextTag(Location=midpt, Text=python.a, Colour=swatch)
